# Grasshopper definition GHDebug_Curves.gh (Grasshopper 1.0.7)

# ---- group: BBox MakeitValid Method
pt = Point(Point(15, 15, 0))
pt_2 = Point(Point(5, 0, 0))
ln = Line(StartPoint=pt, EndPoint=pt_2)
end = EndPoints(Curve=ln)  # -> Start, End
c_script = CSharpScript(l=ln)  # -> out, A; inputs l: Line
# ---------- c_script: C# ----------
    var bBox = l.BoundingBox;
    var bString = bBox.ToString();
    A = bBox.ToString();
# ---------- end c_script ----------
panel = Panel([end.Start, end.End])
panel_2 = Panel(c_script.A)

# ---- group: ClosestPointToSegment
panel_3 = Panel("""{5,7,0}
{7,6,0}
{5,9,0}""")
panel_4 = Panel("""{5,0,0}
{15,15,0}""")
panel_5 = Panel("""{5,5,0}
{10,10,0}
{5,7,0}""")
item = ListItem(List=panel_4, Index=0, Wrap=True)  # -> Item, Item1, Item2
ln_2 = Line(StartPoint=item.Item, EndPoint=item.Item1)
pt_3 = Point(panel_3)
crv_cp = CurveClosestPoint(Point=pt_3, Curve=ln_2)  # -> Point, Parameter, Distance
panel_6 = Panel(crv_cp.Point)
panel_7 = Panel(crv_cp.Parameter)

# ---- group: Arc and Circle / ToNurbs / Verb
panel_8 = Panel("""{74.264416,36.39316,-1.8843129999999997}
{63.73736394529969,26.774907230101093,0.7265431054950776}
{72.2808868605866,15.429871621311115,3.6324963299804987}
{80.8244097758736,4.084836012521206,6.538449554465901}
{93.52800280921122,10.812836698886068,4.6679117389561}
{106.23159584254901,17.54083738525103,2.797373923446271}
{100.92443,30.599893,-0.5851159999999997}""")
panel_9 = Panel("""1
0.7507927793532885
1
0.7507927793532885
1
0.7507927793532885
1""")
panel_10 = Panel("""0
0
0.3333333333333333
0.3333333333333333
0.6666666666666666
0.6666666666666666
1
1""")
pt_4 = Point(panel_8)
nurbcrv = NurbsCurvePWK(Points=pt_4, Weights=panel_9, Knots=panel_10)  # -> Curve, Length, Domain

# ---- group: Arc and Circle
c_script_2 = CSharpScript(x="-30")  # -> out, A, B; inputs x: Double
# ---------- c_script_2: C# ----------
    A = AngularDiff(0, Rhino.RhinoMath.ToRadians(x));
# ---------- c_script_2: C# additional code ----------
  private double AngularDiff(double theta1, double theta2)
  {
    double dif = theta2 - theta1;
    while (dif >= 2 * Math.PI)
      dif -= 2 * Math.PI;
    while (dif <= 0)
      dif += 2 * Math.PI;
    return dif;
  }
# ---------- end c_script_2 ----------
deg = Degrees(Radians=c_script_2.A)
panel_11 = Panel("""{74.264416, 36.39316, -1.884313}
{97.679126, 13.940616, 3.812853}
{100.92443, 30.599893, -0.585116}""")
panel_12 = Panel(deg)
panel_13 = Panel("""10
17.5
22.5""")
panel_14 = Panel("""0.15
0.5
0.72""")
panel_15 = Panel("""{82.248292, 15.836914, 3.443127}
{89.12029, 34.989032, -1.63896}""")
item_2 = ListItem(List=panel_11, Index=0, Wrap=True)  # -> Item, Item1, Item2
rad = Radians(Degrees="450")
c_script_3 = CSharpScript(pt1=item_2.Item, pt2=item_2.Item1, pt3=item_2.Item2)  # -> out, A, B; inputs pt1: Point3d, pt2: Point3d, pt3: Point3d
# ---------- c_script_3: C# ----------
    Arc a = new Arc(pt1, pt2, pt3);
    A = a.AngleDomain;
    B = a.ToNurbsCurve();
# ---------- end c_script_3 ----------
circle = Circle3Pt(PointA=item_2.Item, PointB=item_2.Item1, PointC=item_2.Item2)  # -> Circle, Plane, Radius
xy = XYPlane(Origin=Point(0, 0, 0))
arc = Arc3Pt(PointA=item_2.Item, PointB=item_2.Item1, PointC=item_2.Item2)  # -> Arc, Plane, Radius
dom = ConstructDomain(DomainStart="0", DomainEnd=rad)
dedomain = DeconstructDomain(Domain=c_script_3.A)  # -> Start, End
X = UnitX(Factor=1)
X_2 = Point(item_2.Item1)
F = Point(item_2.Item2)
E = Point(item_2.Item)
pt_5 = Point(panel_15)
deg_2 = Degrees(Radians=dedomain.End)
pln = Plane(arc.Plane)
cir = Circle(Plane=pln, Radius="23")
eval = EvaluateCurve(Curve=reparameterize(cir), Parameter=panel_14)  # -> Point, Tangent, Angle
len = Length(Curve=cir)
align = AlignPlane(Plane=pln, Direction=X)  # -> Plane, Angle
crv_cp_2 = CurveClosestPoint(Point=pt_5, Curve=reparameterize(circle.Circle))  # -> Point, Parameter, Distance
c_script_4 = CSharpScript(pt1=item_2.Item2, plane=pln)  # -> out, A, B; inputs pt1: Point3d, plane: Plane
# ---------- c_script_4: C# ----------
    double x = 0.0;
    double y = 0.0;

    plane.ClosestParameter(pt1, out x, out y);

    Interval a = new Interval(x, y);
    double t = Math.Atan2(y, x);
    if ( t < 0.0 )
      t += 2.0 * Math.PI;
    A = t;
    B = a;
# ---------- end c_script_4 ----------
panel_16 = Panel(eval.Tangent)
panel_17 = Panel(eval.Point)
len_2 = Length(Curve=arc.Arc)
deplane = DeconstructPlane(Plane=pln)  # -> Origin, XAxis, YAxis, ZAxis
arc_2 = Arc3Pt(PointA=E, PointB=X_2, PointC=F)  # -> Arc, Plane, Radius
X_3 = UnitX(Factor=1)
deplane_2 = DeconstructPlane(Plane=align.Plane)  # -> Origin, XAxis, YAxis, ZAxis
arc_3 = Arc(Plane=xy, Radius="15", Angle=dom)  # -> Arc, Length
panel_18 = Panel(crv_cp_2.Point)
arc_4 = CircularArc(arc.Arc)
panel_19 = Panel(len_2)
align_2 = AlignPlane(Plane=arc_2.Plane, Direction=X_3)  # -> Plane, Angle
num = Number(arc_3.Length)
panel_20 = Panel([deplane_2.Origin, deplane_2.XAxis, deplane_2.YAxis, deplane_2.ZAxis])
panel_21 = Panel([deplane.Origin, deplane.XAxis, deplane.YAxis, deplane.ZAxis])
bbox = BoundingBox(Content=cir, Plane=PlaneXY(0, 0, 0))  # -> Box, Box_2
eval_2 = EvaluateCurve(Curve=reparameterize(arc_4), Parameter=panel_14)  # -> Point, Tangent, Angle
eval_3 = EvaluateLength(Curve=arc_4, Length=panel_13, Normalized=False)  # -> Point, Tangent, Parameter
panel_22 = Panel([c_script_4.A, c_script_4.B])
C = Point(arc_2.Plane)
box_corners = BoxCorners(Box=bbox.Box)  # -> CornerA, CornerB, CornerC, CornerD, CornerE, CornerF, CornerG, CornerH
orient = Orient(Geometry=arc.Arc, Source=pln, Target=PlaneXY(0, 0, 0))  # -> Geometry, Transform
c_script_5 = CSharpScript(R=arc_2.Radius, P=align_2.Plane, E=E, C=C, F=F)  # -> out, A; inputs R: Double, P: Plane, E: Point3d, C: Point3d, F: Point3d
# ---------- c_script_5: C# ----------
    // Now consider the top/bottom/left/right extremities of the circle:
    double thetaE = Math.Atan2(E.Y - C.Y, E.X - C.X);
    double thetaF = Math.Atan2(F.Y - C.Y, F.X - C.X);

    List<Point3d> pts = new List<Point3d>();
    if (AnglesInClockwiseSequence(thetaE, 0/*right*/, thetaF))
    {
      pts.Add(P.Origin + P.XAxis * R);
    }
    if (AnglesInClockwiseSequence(thetaE, Math.PI / 2/*bottom*/, thetaF))
    {
      pts.Add(P.Origin + P.YAxis * R);
    }
    if (AnglesInClockwiseSequence(thetaE, Math.PI/*left*/, thetaF))
    {
      pts.Add(P.Origin - P.XAxis * R);
    }
    if (AnglesInClockwiseSequence(thetaE, Math.PI * 3 / 2/*top*/, thetaF))
    {
      pts.Add(P.Origin - P.YAxis * R);
    }

    A = pts;
# ---------- c_script_5: C# additional code ----------
  public static bool AnglesInClockwiseSequence(double x, double y, double z)
  {
    return AngularDiffSigned(x, y) + AngularDiffSigned(y, z) < 2 * Math.PI;
  }

  public static double AngularDiffSigned(double theta1, double theta2)
  {
    double dif = theta2 - theta1;
    while (dif >= 2 * Math.PI)
      dif -= 2 * Math.PI;
    while (dif <= 0)
      dif += 2 * Math.PI;
    return dif;
  }
# ---------- end c_script_5 ----------
panel_23 = Panel(eval_3.Point)
panel_24 = Panel(eval_3.Tangent)
panel_25 = Panel(eval_2.Point)
panel_26 = Panel(eval_2.Tangent)
pt_6 = Point(box_corners.CornerA)
pt_7 = Point(box_corners.CornerG)
eval_4 = EvaluateLength(Curve=cir, Length=panel_13, Normalized=False)  # -> Point, Tangent, Parameter
bbox_2 = BoundingBox(Content=arc_2.Arc, Plane=PlaneXY(0, 0, 0))  # -> Box, Box_2
panel_27 = Panel("""0.0
1.0""")
box_corners_2 = BoxCorners(Box=bbox_2.Box)  # -> CornerA, CornerB, CornerC, CornerD, CornerE, CornerF, CornerG, CornerH
panel_28 = Panel(eval_4.Point)
panel_29 = Panel(eval_4.Tangent)
panel_30 = Panel(crv_cp_2.Parameter)
panel_31 = Panel([pt_6, pt_7])
panel_32 = Panel([num, pt_6, arc_3.Arc, pt_7])
pt_8 = Point(box_corners_2.CornerA)
pt_9 = Point(box_corners_2.CornerG)
eval_5 = EvaluateCurve(Curve=reparameterize(orient.Geometry), Parameter=panel_27)  # -> Point, Tangent, Angle
panel_33 = Panel([pt_8, pt_9])
cos = Cosine(Value="0.324263")
panel_34 = Panel(eval_5.Point)
sin = Sine(Value="0.324263")
multiplication = Multiplication(A="23", B=cos)
multiplication_2 = Multiplication(A="23", B=sin)
c_script_6 = CSharpScript(S="{ 5, 5, 5 }", E="{ 10, 15, 10 }", D="{ 3, 3, 0 }")  # -> out, A, B, C, P, T; inputs S: Point3d, E: Point3d, D: Vector3d
# ---------- c_script_6: C# ----------
    Vector3d vector3d1 = D;
    Vector3d vector3d2 = E - S;
    vector3d2.Unitize();
    vector3d1.Unitize();
    Vector3d vector3d3 = vector3d2 + vector3d1;
    vector3d3.Unitize();
    Vector3d vector3d4 = vector3d3 * (0.5 * S.DistanceTo(E) / (vector3d3 * vector3d1));
    Arc arc = new Arc(S, S + vector3d4, E);
    Circle c = new Circle(S, S + vector3d4, E);
    B = S + vector3d4;
    A = arc;
    C = c.ToNurbsCurve();
    P = arc.PointAt(4.00);
    T = c.Plane.PointAt(c.Radius, c.Radius);
# ---------- end c_script_6 ----------
panel_35 = Panel("""0.03
0.1
0.13""")
arc_5 = ArcSED(Start="{ 5, 5, 5 }", End="{ 10, 15, 10 }", Direction="{ 3, 3, 0 }")  # -> Arc, Plane, Radius
cdiv = Derivatives(Curve=reparameterize(circle.Circle), Parameter="0.15")  # -> Point, FirstDerivative, SecondDerivative, ThirdDerivative
multiplication_3 = Multiplication(A=deplane.YAxis, B=multiplication_2)
multiplication_4 = Multiplication(A=deplane.XAxis, B=multiplication)
c_script_7 = CSharpScript(x=cir, y=panel_35)  # -> out, A; inputs y: Double
# ---------- c_script_7: C# ----------
    double t;
    x.ToNurbsCurve().NormalizedLengthParameter(y, out t);

    Print(t.ToString());
# ---------- end c_script_7 ----------
pln_2 = Plane(arc_5.Plane)
panel_36 = Panel([cdiv.Point, cdiv.FirstDerivative, cdiv.SecondDerivative, cdiv.ThirdDerivative])
addition = Addition(A=multiplication_4, B=multiplication_3)
deplane_3 = DeconstructPlane(Plane=pln_2)  # -> Origin, XAxis, YAxis, ZAxis
lenp = LengthParameter(Curve=reparameterize(cir), Parameter=c_script_7.out)  # -> Length, Length_2
panel_37 = Panel(c_script_7.out)
panel_38 = Panel(arc_5.Arc)
panel_39 = Panel([deplane_3.XAxis, deplane_3.YAxis, deplane_3.ZAxis, deplane_3.Origin])
addition_2 = Addition(A=deplane.Origin, B=addition)
panel_40 = Panel(lenp.Length)
panel_41 = Panel([multiplication, multiplication_2, addition_2])

# ---- group: PointAt
panel_42 = Panel("""0
0.15
0.36
0.85
1""")
ln_3 = Line(StartPoint=pt_2, EndPoint=pt)
eval_6 = EvaluateCurve(Curve=ln_3, Parameter=panel_42)  # -> Point, Tangent, Angle
panel_43 = Panel(eval_6.Point)

# ---- group: Flip
vec = Vector(ln_3)
pl = PlaneNormal(Origin=pt_2, ZAxis=vec)
pflip = FlipPlane(Plane=pl, ReverseX=False, ReverseY=False, SwapAxes=True)
deplane_4 = DeconstructPlane(Plane=pl)  # -> Origin, XAxis, YAxis, ZAxis
panel_44 = Panel([deplane_4.Origin, deplane_4.XAxis, deplane_4.YAxis, deplane_4.ZAxis])

# ---- group: Plane 3Pts
pt_10 = Point(Point(5, 5, 0))
pt_11 = Point(Point(-5, 10, 0))
pt_12 = Point(Point(20, 20, 0))
pl_3pt = Plane3Pt(PointA=pt_12, PointB=pt_10, PointC=pt_11)
deplane_5 = DeconstructPlane(Plane=pl_3pt)  # -> Origin, XAxis, YAxis, ZAxis
panel_45 = Panel([deplane_5.Origin, deplane_5.XAxis, deplane_5.YAxis, deplane_5.ZAxis])

# ----
X_4 = UnitX(Factor=1)

# ---- group: Transformation
rad_2 = Radians(Degrees="30")
move = Move(Motion=ln_3)  # -> Geometry, Transform
rotate = Rotate(Angle=rad_2, Plane=PlaneXY(0, 0, 0))  # -> Geometry, Transform
comp = Compound(Transforms=[rotate.Transform, move.Transform])
transform = Transform(Geometry=pl_3pt, Transform=comp)
deplane_6 = DeconstructPlane(Plane=transform)  # -> Origin, XAxis, YAxis, ZAxis
panel_46 = Panel([deplane_6.Origin, deplane_6.XAxis, deplane_6.YAxis, deplane_6.ZAxis])

# ----
X_5 = UnitX(Factor=1)
addition_3 = Addition(A=deplane_5.Origin, B=X_4)
align_3 = AlignPlane(Plane=pl_3pt, Direction=X_5)  # -> Plane, Angle
pt_13 = Point(addition_3)
plcoord = PlaneCoordinates(Point=pt_13, System=pl_3pt)  # -> XCoordinate, YCoordinate, ZCoordinate

# ---- group: Amplitude
panel_47 = Panel("""{5,5,0}
{10,10,0}
{20,15,0}
{35,15,0}""")
panel_48 = Panel("""0
15
33
46""")
amp = Amplitude(Vector=panel_47, Amplitude=panel_48)
panel_49 = Panel(amp)

# ----
expression = Expression(x=plcoord.XCoordinate, y=plcoord.YCoordinate, Expression="Atan2(x,y)")

# ---- group: Arc and Circle / ToNurbs
cp = ControlPoints(Curve=arc.Arc)  # -> Points, Weights, Knots
yz = YZPlane(Origin=Point(0, 0, 0))
panel_50 = Panel(cp.Knots)
c_script_8 = CSharpScript(pl=yz)  # -> out, A; inputs pl: Plane
# ---------- c_script_8: C# ----------
    Circle c = new Circle(pl, 20);
    Arc arc = new Arc(c, 1.8);
    A = arc;
# ---------- end c_script_8 ----------
cp_2 = ControlPoints(Curve=reparameterize(c_script_8.A))  # -> Points, Weights, Knots
panel_51 = Panel(cp_2.Weights)

# ----
deg_3 = Degrees(Radians=expression)

# ---- group: RationCurveClosestParameter
panel_52 = Panel("""{5,7,0}
{12,10,0}
{21,17,0}
{32,15,0}
{41,8,0}
{50,5,0}""")
panel_53 = Panel("""{5,5,0}
{10,10,0}
{20,15,0}
{35,15,0}
{45,10,0}
{50,5,0}""")
pt_14 = Point(panel_52)
nurbs = NurbsCurve(Vertices=panel_53, Degree="3", Periodic=False)  # -> reparameterize(Curve), Length, Domain
crv_cp_3 = CurveClosestPoint(Point=pt_14, Curve=nurbs.Curve)  # -> Point, Parameter, Distance
panel_54 = Panel(crv_cp_3.Parameter)
panel_55 = Panel(crv_cp_3.Point)

# ----
panel_56 = Panel(deg_3)

# ---- group: Rotation
prot = RotatePlane(Plane=pl_3pt, Angle=rad_2)
deplane_7 = DeconstructPlane(Plane=align_3.Plane)  # -> Origin, XAxis, YAxis, ZAxis
panel_57 = Panel([deplane_7.Origin, deplane_7.XAxis, deplane_7.YAxis, deplane_7.ZAxis])

# ---- group: CurveTransformation
pt_15 = Point(Point(-10, 20, 0))
move_2 = Move(Motion=pt_15)  # -> Geometry, Transform
transform_2 = Transform(Geometry=nurbs.Curve, Transform=move_2.Transform)
eval_7 = EvaluateCurve(Curve=transform_2, Parameter=0)  # -> Point, Tangent, Angle
eval_8 = EvaluateCurve(Curve=nurbs.Curve, Parameter=0)  # -> Point, Tangent, Angle
dist = Distance(PointA=eval_7.Point, PointB=eval_8.Point)
panel_58 = Panel(dist)

# ---- group: PythonNurbsLinearSpace
python = GhPythonScript()  # -> out, a
# ---------- python: Python ----------
__author__ = "m.bianchini"
__version__ = "2021.01.09"

import rhinoscriptsyntax as rs


def linspace(start, stop, num, decimals=18):
    """ Returns a list of evenly spaced numbers over a specified interval.
    Inspired from Numpy's linspace function: https://github.com/numpy/numpy/blob/master/numpy/core/function_base.py
    :param start: starting value
    :type start: float
    :param stop: end value
    :type stop: float
    :param num: number of samples to generate
    :type num: int
    :param decimals: number of significands
    :type decimals: int
    :return: a list of equally spaced numbers
    :rtype: list
    """
    start = float(start)
    stop = float(stop)
    if abs(start - stop) <= 10e-8:
        return [start]
    num = int(num)
    if num > 1:
        div = num - 1
        delta = stop - start
        return [float(("{:." + str(decimals) + "f}").format((start + (float(x) * float(delta) / float(div)))))
                for x in range(num)]
    return [float(("{:." + str(decimals) + "f}").format(start))]
    
a = linspace(0.0,1.0,8)
# ---------- end python ----------
panel_59 = Panel(python.a)

# ---- group: CollinearPts using triangle area without square the area and divided
pt_16 = Point(<point referenced from the Rhino model>)
pt_17 = Point(<point referenced from the Rhino model>)
pt_18 = Point(<point referenced from the Rhino model>)
subtraction = Subtraction(A=pt_18, B=pt_16)
subtraction_2 = Subtraction(A=pt_17, B=pt_16)
pline = PolyLine(Vertices=[pt_16, pt_17, pt_18], Closed=True)
xprod = CrossProduct(VectorA=subtraction_2, VectorB=subtraction, Unitize=False)  # -> Vector, Length
area = Area(Geometry=pline)  # -> Area, Centroid
dprod = DotProduct(VectorA=xprod.Vector, VectorB=xprod.Vector, Unitize=False)
sqrt = SquareRoot(Value=dprod)
division = Division(A=sqrt, B=2)
multiplication_5 = Multiplication(A=sqrt, B=0.5)
panel_60 = Panel([dprod, area.Area, division, multiplication_5])

# ---- group: Unitized
vec_2 = Vector(Vector(15.19032948, 29.8990158, 0))
vlen = VectorLength(Vector=vec_2)
division_2 = Division(A=1, B=vlen)
unit = UnitVector(Vector=vec_2)
multiplication_6 = Multiplication(A=vec_2, B=division_2)
vdis = VectorDisplay(Anchor=Point(0.1183940464, -0.03405877464, 0), Vector=[vec_2, unit])

# ---- group: Polygon
panel_61 = Panel("""{74.264416, 36.39316, -1.884313}
{79.65881, 22.402983, 1.741763}
{97.679126, 13.940616, 3.812853}
{100.92443, 30.599893, -0.585116}
{78.805261, 45.16886, -4.22451}
{74.264416, 36.39316, -1.884313}""")
panel_62 = Panel("""{1,1,0} 
{10,1,0} 
{2,10,0} 
{1,10,0} 
{1,1,0}""")
pline_2 = PolyLine(Vertices=panel_61, Closed=False)
pcen = PolygonCenter(Polyline=pline_2)  # -> CenterV, CenterE, CenterA
cp_3 = ControlPoints(Curve=pline_2)  # -> Points, Weights, Knots
c_script_9 = CSharpScript(poly=pline_2)  # -> out, A; inputs poly: Polyline
# ---------- c_script_9: C# ----------
    A = poly.ToNurbsCurve();
# ---------- end c_script_9 ----------
plfit = PlaneFit(Points=cp_3.Points)  # -> Plane, Deviation
cp_4 = ControlPoints(Curve=reparameterize(c_script_9.A))  # -> Points, Weights, Knots
pl_origin = PlaneOrigin(Base=plfit.Plane, Origin=pcen.CenterV)
c_script_10 = CSharpScript(x=pline_2)  # -> out, A; inputs x: Polyline
# ---------- c_script_10: C# ----------
    var a = Rhino.Geometry.AreaMassProperties.Compute(x.ToNurbsCurve());
    Print(a.Area.ToString());
# ---------- end c_script_10 ----------
pline_3 = PolyLine(Vertices=panel_62, Closed=True)
panel_63 = Panel(cp_4.Knots)
panel_64 = Panel(cp_4.Points)
cp_5 = PlaneClosestPoint(Point=cp_3.Points, Plane=pl_origin)  # -> Point, UVPoint, Distance
pcen_2 = PolygonCenter(Polyline=pline_3)  # -> CenterV, CenterE, CenterA
deplane_8 = DeconstructPlane(Plane=pl_origin)  # -> Origin, XAxis, YAxis, ZAxis
area_2 = Area(Geometry=pline_3)  # -> Area, Centroid
area_3 = Area(Geometry=pline_2)  # -> Area, Centroid
panel_65 = Panel([area_2.Area, area_3.Area, c_script_10.out])
sort = SortList(Keys=cp_5.Distance, ValuesA=cp_5.Point)  # -> reverse(Keys), reverse(ValuesA)
rev = Reverse(Vector=deplane_8.ZAxis)
vdis_2 = VectorDisplay(Anchor=deplane_8.Origin, Vector=rev)
pt_19 = Point(sort.ValuesA)
panel_66 = Panel([deplane_8.Origin, deplane_8.ZAxis])

# ---- group: ReverseKnotsNurbsPython
python_2 = GhPythonScript()  # -> out, a
# ---------- python_2: Python ----------
__author__ = "m.bianchini"
__version__ = "2021.02.02"

import rhinoscriptsyntax as rs

kv = [0, 0, 0, 0, 1, 1, 2, 2, 2, 3, 3.3, 4, 4, 4]

max_k = kv[-1]
new_kv = [max_k - k for k in kv]

a = list(reversed(new_kv))
# ---------- end python_2 ----------
panel_67 = Panel(python_2.a)

# ---- group: DivideByLength
panel_68 = Panel("""{5,5,0}
{10,10,0}
{20,15,0}
{35,15,0}
{45,10,0}
{50,5,0}""")
panel_69 = Panel("3")
panel_70 = Panel("""0
15
33
46""")
nurbs_2 = NurbsCurve(Vertices=panel_68, Degree=panel_69, Periodic=False)  # -> reparameterize(Curve), Length, Domain
len_3 = Length(Curve=nurbs_2.Curve)
merge = Merge(Data1=panel_70, Data2=len_3)
eval_9 = EvaluateLength(Curve=nurbs_2.Curve, Length=merge, Normalized=False)  # -> Point, Tangent, Parameter
panel_71 = Panel(eval_9.Parameter)

# ---- group: CurveDerivatives
python_3 = GhPythonScript(x=Slider(2, range=0..2))  # -> out, a; inputs x: Int32
# ---------- python_3: Python ----------
__author__ = "m.bianchini"
__version__ = "2021.01.19"

import rhinoscriptsyntax as rs
basis = [[0,0,1],[0,-2,2],[2,-4,2]]
ctrlpts = [[1,0,0,1],[1,1,0,1],[0,2,0,2]]

eval_points = []
for idx in range(2+1):
    crvpt = [0.0 for _ in range(4)]
    for i in range(0, 2 + 1):
        crvpt[:] = [crv_p + (basis[idx][i] * ctl_p) for crv_p, ctl_p in
                    zip(crvpt, ctrlpts[2 - 2 + i])]

    eval_points.append(crvpt)

eval_points.append(crvpt)

a = eval_points[x]
# ---------- end python_3 ----------
panel_72 = Panel(python_3.a)

# ----
panel_73 = Panel(pcen.CenterA)

# ---- group: PlaneFromNormal
pt_20 = ConstructPoint(XCoordinate="-7", YCoordinate="10", ZCoordinate="-5")
pt_21 = ConstructPoint(XCoordinate=0, YCoordinate=0, ZCoordinate=0)
c_script_11 = CSharpScript(x=pt_20)  # -> out, A; inputs x: Vector3d
# ---------- c_script_11: C# ----------
    var yAxis = Vector3d.YAxis;
    yAxis.PerpendicularTo(x);
    A = yAxis;
# ---------- end c_script_11 ----------
pl_2 = PlaneNormal(Origin=pt_21, ZAxis=pt_20)
deplane_9 = DeconstructPlane(Plane=pl_2)  # -> Origin, XAxis, YAxis, ZAxis
vdis_3 = VectorDisplay(Anchor=pt_21, Vector=[deplane_9.YAxis, c_script_11.A])
panel_74 = Panel(deplane_9.XAxis)
panel_75 = Panel(c_script_11.A)

# ----
panel_76 = Panel(pcen_2.CenterA)

# ---- group: PointAt
nurbs_3 = NurbsCurve(Vertices=panel_68, Degree=panel_69, Periodic=False)  # -> reparameterize(Curve), Length, Domain
panel_77 = Panel("""0.0
0.3
0.5
0.6
1.0""")
eval_10 = EvaluateCurve(Curve=nurbs_3.Curve, Parameter=panel_77)  # -> Point, Tangent, Angle
panel_78 = Panel(eval_10.Point)

# ---- group: CurvesIntersection
panel_79 = Panel("""{ 2.225594, 1.226218, 2.01283}
{ 8.681402, 4.789645, 5.010206}
{ 6.181402, 4.789645, 0.010206}
{ 1.181402, 7.289645, 5.010206}
{ 8.496731, 9.656647, 2.348212}""")
panel_80 = Panel("""{-5,0,0}
{5,-1,0}
{10,5,0}
{3,10,0}
{5, 12, 0}""")
panel_81 = Panel("""{-5,0,0}
{10,0,0}
{10,10,0}
{0,10,0}
{5, 5, 0}""")
panel_82 = Panel("""{0, 0, 0}
{5, 2.5, 5}
{5, 5, 0}
{7.5, 10, 5}
{10, 10, 0}""")
panel_83 = Panel("""1
1
1
1
1""")
panel_84 = Panel("""1
1
1
1
1""")
panel_85 = Panel("""0.0
0.0 
0.0 
0.5
1.0 
1.0
1.0""")
panel_86 = Panel("""0.0
0.0 
0.0 
0.5
1.0 
1.0
1.0""")
nurbcrv_2 = NurbsCurvePWK(Points=panel_80, Weights=panel_83, Knots=panel_85)  # -> reparameterize(Curve), Length, Domain
nurbcrv_3 = NurbsCurvePWK(Points=panel_81, Weights=panel_83, Knots=panel_85)  # -> reparameterize(Curve), Length, Domain
nurbcrv_4 = NurbsCurvePWK(Points=panel_79, Weights=panel_84, Knots=panel_86)  # -> reparameterize(Curve), Length, Domain
nurbcrv_5 = NurbsCurvePWK(Points=panel_82, Weights=panel_84, Knots=panel_86)  # -> reparameterize(Curve), Length, Domain
ccx = CurveCurve(CurveA=nurbcrv_3.Curve, CurveB=nurbcrv_2.Curve)  # -> Points, ParamsA, ParamsB
ccx_2 = CurveCurve(CurveA=nurbcrv_5.Curve, CurveB=nurbcrv_4.Curve)  # -> Points, ParamsA, ParamsB
panel_87 = Panel(ccx_2.Points)
panel_88 = Panel(ccx.ParamsA)

# ---- group: Oriented BoundingBox
panel_89 = Panel("""{ 74.264416, 36.39316, -1.884313}
{ 79.65881, 22.402983, 1.741763}
{ 97.679126, 13.940616, 3.812853}
{ 100.92443, 30.599893, -0.585116}
{ 78.805261, 45.16886, -4.22451}
{ 74.264416, 36.39316, -1.884313}""")
xy_2 = XYPlane(Origin=Point(0, 0, 0))
rad_3 = Radians(Degrees="30")
prot_2 = RotatePlane(Plane=xy_2, Angle=rad_3)
orient_2 = Orient(Source=xy_2, Target=prot_2)  # -> Geometry, Transform
pt_22 = Point(panel_89)
transform_3 = Transform(Geometry=pt_22, Transform=orient_2.Transform)
bbox_3 = BoundingBox(Content=transform_3, Plane=PlaneXY(0, 0, 0), UnionBox=True)  # -> Box, Box_2
bbox_4 = BoundingBox(Content=pt_22, Plane=prot_2, UnionBox=True)  # -> Box, Box_2
box_corners_3 = BoxCorners(Box=bbox_4.Box_2)  # -> CornerA, CornerB, CornerC, CornerD, CornerE, CornerF, CornerG, CornerH
box_corners_4 = BoxCorners(Box=bbox_3.Box)  # -> CornerA, CornerB, CornerC, CornerD, CornerE, CornerF, CornerG, CornerH
pt_23 = Point(box_corners_3.CornerA)
pt_24 = Point(box_corners_3.CornerC)
pt_25 = Point(box_corners_3.CornerG)
pt_26 = Point(box_corners_4.CornerA)
pt_27 = Point(box_corners_4.CornerG)
pt_28 = Point(box_corners_4.CornerC)
panel_90 = Panel([pt_23, pt_24, pt_25])
panel_91 = Panel([pt_26, pt_28, pt_27])

# ---- group: LineLine
ln_4 = Line(StartPoint="{-5,5,0}", EndPoint="{5,5,5}")
ln_5 = Line(StartPoint="{0,0,0}", EndPoint="{3,3,2}")
ln_6 = Line(StartPoint="{0,0,0}", EndPoint="{0,20,0}")
ln_7 = Line(StartPoint="{-5,5,0}", EndPoint="{5,5,0}")
llx = LineLine(Line1=ln_4, Line2=ln_5)  # -> ParamA, ParamB, PointA, PointB
panel_92 = Panel([llx.PointA, llx.PointB])

# ---- group: CurvePlaneIntersection
panel_93 = Panel("""{0,0,0}
{0.5,0.5,0}
{2,0,0}""")
panel_94 = Panel("""{0.25,0,0}
{0.75,0,0}
{1,0,0}
{1.75,0,0}""")
panel_95 = Panel("""1
1
1""")
panel_96 = Panel("""0.0
0.0
1.0
1.0""")
pt_29 = Point("{6,0,0}")
yz_2 = YZPlane(Origin=pt_29)
pt_30 = Point(panel_94)
nurbcrv_6 = NurbsCurvePWK(Points=panel_93, Weights=panel_95, Knots=panel_96)  # -> reparameterize(Curve), Length, Domain
yz_3 = YZPlane(Origin=pt_30)
rotate_2 = Rotate(Geometry=yz_2, Angle="0.15", Plane=PlaneXY(0, 0, 0))  # -> Geometry, Transform
pcx = CurvePlane(Curve=nurbcrv_4.Curve, Plane=rotate_2.Geometry)  # -> Points, ParamsC, ParamsP
pcx_2 = CurvePlane(Curve=nurbcrv_6.Curve, Plane=yz_3)  # -> Points, ParamsC, ParamsP
panel_97 = Panel([pcx_2.Points, pcx_2.ParamsC])
panel_98 = Panel([pcx.Points, pcx.ParamsC, pcx.ParamsP])

# ---- group: ClampedNurbs
panel_99 = Panel("3")
nurbs_4 = NurbsCurve(Vertices=[Point(0, 5, 5), Point(0, 0, 0), Point(4, 0, 0), Point(5, 5, 5), Point(0, 5, 0)], Degree=3, Periodic=True)  # -> Curve, Length, Domain
bbox_5 = BoundingBox(Content=nurbs_4.Curve, Plane=PlaneXY(0, 0, 0))  # -> Box, Box_2
cp_6 = ControlPoints(Curve=nurbs_4.Curve)  # -> Points, Weights, Knots
box_corners_5 = BoxCorners(Box=bbox_5.Box)  # -> CornerA, CornerB, CornerC, CornerD, CornerE, CornerF, CornerG, CornerH
c_script_12 = CSharpScript(c=nurbs_4.Curve)  # -> out, Both, B, C; inputs c: Curve, t: Double
# ---------- c_script_12: C# ----------
    NurbsCurve nurbsCurve = c.ToNurbsCurve();

    if (nurbsCurve.IsPeriodic)
    {
      nurbsCurve.Knots.ClampEnd(CurveEnd.Both);
    }

    List<double> cv = new List<double>();
    foreach (var pt in nurbsCurve.Points)
    {
      cv.Add(pt.X);
      cv.Add(pt.Y);
      cv.Add(pt.Z);
      cv.Add(pt.Weight);
    }


    Both = nurbsCurve;
    B = (nurbsCurve.IsRational) ? nurbsCurve.Dimension + 1 : nurbsCurve.Dimension;
    C = nurbsCurve.Order;
# ---------- end c_script_12 ----------
pt_31 = Point(box_corners_5.CornerG)
pt_32 = Point(box_corners_5.CornerA)
cp_7 = ControlPoints(Curve=c_script_12.Both)  # -> Points, Weights, Knots
panel_100 = Panel([pt_32, pt_31])
panel_101 = Panel(cp_7.Points)

# ---- group: SelfIntersection
panel_102 = Panel("""{0, 5, 0}
{2.5, 0, 0}
{5, 2.5, 0}
{2.5, 5, 0}
{0, 0, 0}
{5, 0, 0}
{2.5, 5, 0}""")
panel_103 = Panel("""1
1
1
1
1
1
1""")
panel_104 = Panel("""{0, 5, 5}
{2.5, 0, 0}
{5, 5, 2.5}
{2.5, 5, 5}
{0, 0, 0}""")
panel_105 = Panel("""1
1
1
1
1""")
panel_106 = Panel("""0.0
0.0
0.0
0.25
0.5
0.75
1.0
1.0
1.0""")
panel_107 = Panel("""0.0
0.0
0.0
0.5
1.0
1.0
1.0""")
nurbcrv_7 = NurbsCurvePWK(Points=panel_102, Weights=panel_103, Knots=panel_106)  # -> reparameterize(Curve), Length, Domain
nurbcrv_8 = NurbsCurvePWK(Points=panel_104, Weights=panel_105, Knots=panel_107)  # -> reparameterize(Curve), Length, Domain
cx = CurveSelf(Curve=nurbcrv_7.Curve)  # -> Points, Params
cx_2 = CurveSelf(Curve=nurbcrv_8.Curve)  # -> Points, Params
panel_108 = Panel(cx.Params)
panel_109 = Panel(cx_2.Points)

# ----
pt_33 = Point("{8.530940,5,-7.279316}")
vec_3 = Vector("{0.684899,0.000000,12.527001}")
vec_4 = Vector("{7.457979,0.000000,-2.292423}")
xprod_2 = CrossProduct(VectorA=vec_4, VectorB=vec_3, Unitize=False)  # -> Vector, Length

# ---- group: ClampedNurbs / EvalDeBoor - FromOpenNurbs / End
c_script_13 = CSharpScript(c=nurbs_4.Curve)  # -> out, A, B, C; inputs c: Curve
# ---------- c_script_13: C# ----------
    NurbsCurve nurbsCurve = c.ToNurbsCurve();

    // Points converted in a list of doubles as of their cv input.
    List<double> cv = new List<double>();
    foreach (var pt in nurbsCurve.Points)
    {
      cv.Add(pt.X);
      cv.Add(pt.Y);
      cv.Add(pt.Z);
      if(nurbsCurve.IsRational)
      {
        cv.Add(pt.Weight);
      }
    }

    C = cv;

    // https://github.com/mcneel/opennurbs/blob/2b96cf31429dab25bf8a1dbd171227c506b06f88/opennurbs_knot.cpp#L1168
    int i0 = nurbsCurve.Points.Count - nurbsCurve.Order;
    int cv_stride = (nurbsCurve.IsRational) ? nurbsCurve.Dimension + 1 : nurbsCurve.Dimension;
    int knotsPreStart = i0;
    int cvPreStart = i0 * cv_stride;
    double t = nurbsCurve.Knots[knotsPreStart + nurbsCurve.Order - 1];
    Print("knotsPreStart -->" + knotsPreStart.ToString());
    Print("cvPreStart -->" + cvPreStart.ToString());
    Print("t -->" + t.ToString());

    // delta_t = {t - knot[order-2], t - knot[order-1], ... , t - knot[0]}
    List<double> delta_t = new List<double>();
    int knotsStart = nurbsCurve.Degree - 1;

    int k = nurbsCurve.Degree;
    int i = 0;
    while(k-- > 0)
    {
      delta_t.Add(t - nurbsCurve.Knots[knotsPreStart + knotsStart - i]);
      i++;
    }

    B = delta_t;

    // https://github.com/mcneel/opennurbs/blob/2b96cf31429dab25bf8a1dbd171227c506b06f88/opennurbs_evaluate_nurbs.cpp#L1414
    int ptsStart = nurbsCurve.Order * cv_stride;
    int j = nurbsCurve.Order;
    while(--j > 0) // while(--k)
    {
      // Data
      Print("Start the primary while");
      string cvString = "";
      for (int v = 0; v < cv.Count; v++)
      {
        cvString += cv[v].ToString() + "-";
      }
      Print("Cv -->" + cvString);

      int m = j;
      int counter = 0;
      int ptsCounter = 0;
      while(m-- > 0) // while(i--)
      {
        double k0 = nurbsCurve.Knots[knotsPreStart + knotsStart - counter];
        double k1 = nurbsCurve.Knots[knotsPreStart + knotsStart + j - counter];
        Print("k0 -->" + k0.ToString());
        Print("k1 -->" + k1.ToString());

        double alpha1 = delta_t[counter] / (k1 - k0);
        double alpha0 = 1.0 - alpha1;
        Print("alpha0 -->" + alpha0.ToString());
        Print("alpha1 -->" + alpha1.ToString());

        int n = nurbsCurve.Dimension;
        int ptCounter = 0;
        while(n-- > 0) // while(j--)
        {
          ptCounter++;
          var cv1 = cv[cvPreStart + ptsStart - ptCounter - ptsCounter];
          Print("Cv1 -->" + cv1.ToString());
          var cv0 = cv[cvPreStart + ptsStart - cv_stride - ptCounter - ptsCounter];
          Print("Cv0 -->" + cv0.ToString());

          cv[cvPreStart + ptsStart - ptCounter - ptsCounter] = (cv0 * alpha0) + (cv1 * alpha1);
          Print("cv[]" + (cvPreStart + ptsStart - ptCounter - ptsCounter).ToString() + "-->" + cv[cvPreStart + ptsStart - ptCounter - ptsCounter].ToString());
        }

        counter++;
        ptsCounter += cv_stride; // this is equivalent to cv_inc = cv_stride - cv_dim
      }
    }

    List<Point3d> pts = new List<Point3d>();
    for (int h = 0; h < cv.Count; h += cv_stride)
    {
      pts.Add(new Point3d(cv[h], cv[h + 1], cv[h + 2]));
    }

    A = pts;
# ---------- end c_script_13 ----------

# ---- group: ClampedNurbs / EvalDeBoor - FromOpenNurbs / Start
c_script_14 = CSharpScript(c=nurbs_4.Curve)  # -> out, A, B; inputs c: Curve
# ---------- c_script_14: C# ----------
    NurbsCurve nurbsCurve = c.ToNurbsCurve();

    double t = nurbsCurve.Knots[nurbsCurve.Order - 2];
    Print("t -->" + t.ToString());

    // delta_t = {knot[order-1] - t, knot[order] -  t, .. knot[2*order-3] - t}
    List<double> delta_t = new List<double>();
    int knotsStart = nurbsCurve.Degree;

    int k = nurbsCurve.Degree;
    int i = 0;
    while(k-- > 0)
    {
      delta_t.Add(nurbsCurve.Knots[knotsStart + i] - t);
      i++;
    }

    // Points converted in a list of doubles as of their cv input.
    int cv_stride = (nurbsCurve.IsRational) ? nurbsCurve.Dimension + 1 : nurbsCurve.Dimension;
    List<double> cv = new List<double>();
    foreach (var pt in nurbsCurve.Points)
    {
      cv.Add(pt.X);
      cv.Add(pt.Y);
      cv.Add(pt.Z);
      if(nurbsCurve.IsRational)
      {
        cv.Add(pt.Weight);
      }
    }

    Print("PointSize -->" + nurbsCurve.Points.PointSize.ToString());
    Print("Delta -->" + delta_t.Count.ToString());

    int j = nurbsCurve.Order;
    int deltaInt = nurbsCurve.Degree;
    while(--j > 0) // while(--k)
    {
      // Data
      Print("Start the primary while");
      string cvString = "";
      for (int v = 0; v < cv.Count; v++)
      {
        cvString += cv[v].ToString() + "-";
      }
      Print("Cv -->" + cvString);

      int m = j;
      int counter = 0;
      int ptsCounter = 0;
      //Print("deltaStart -->" + (delta_t.Count - deltaInt).ToString());

      while(m-- > 0) // while(i--)
      {
        double k0 = nurbsCurve.Knots[knotsStart - j + counter];
        double k1 = nurbsCurve.Knots[knotsStart + counter];
        Print("k0 -->" + k0.ToString());
        Print("k1 -->" + k1.ToString());

        double alpha0 = delta_t[counter] / (k1 - k0);
        double alpha1 = 1.0 - alpha0;

        Print("alpha0 -->" + alpha0.ToString());
        Print("alpha1 -->" + alpha1.ToString());

        int n = nurbsCurve.Dimension;
        int ptCounter = 0;
        while(n-- > 0) // while(j--)
        {
          var cv1 = cv[cv_stride + ptCounter + ptsCounter];
          Print("Cv1 -->" + cv1.ToString());
          var cv0 = cv[ptCounter + ptsCounter];
          Print("Cv0 -->" + cv0.ToString());

          cv[ptCounter + ptsCounter] = (cv0 * alpha0) + (cv1 * alpha1);
          Print("cv[]" + (ptCounter + ptsCounter).ToString() + "-->" + cv[ptCounter + ptsCounter].ToString());
          ptCounter++;
        }

        counter++;
        deltaInt = j;
        ptsCounter += cv_stride; // this is equivalent to cv_inc = cv_stride - cv_dim
      }
    }

    List<Point3d> pts = new List<Point3d>();
    for (int h = 0; h < cv.Count; h += cv_stride)
    {
      pts.Add(new Point3d(cv[h], cv[h + 1], cv[h + 2]));
    }

    A = pts;
    B = delta_t;
# ---------- end c_script_14 ----------

# ---- group: ClampedNurbs / EvalDeBoor - FromOpenNurbs
lng = ListLength(List=cp_6.Points)
int = Integer(panel_99)
c_script_15 = CSharpScript(degree=int, ctrlPt=lng)  # -> out, A; inputs degree: Int32, ctrlPt: Int32
# ---------- c_script_15: C# ----------
    int order = degree;
    int cv_count = ctrlPt;
    double[] knot = new double[order + cv_count + 1];

    if ( order >= 2 && cv_count >= order)
    {
      double k = 0.0;
      int i, t, knot_count = cv_count + degree + 1;

      double delta = 1.0 / (cv_count - degree);

      for (i = order, t = 0, k = 0.0; i < knot_count; i++, t++, k += delta)
      {
        knot[i] = k;
      }

      for ( i = order - 1, k = -delta; i >= 0; i--, k -= delta )
        knot[i] = k;
    }
    A = knot;
# ---------- end c_script_15 ----------
cull_i = CullIndex(List=c_script_15.A, Indices=[0, -1], Wrap=True)
c_script_16 = CSharpScript(c=nurbs_4.Curve, knots=cull_i)  # -> out, A, B; inputs c: Curve, knots: list of Double
# ---------- c_script_16: C# ----------
    NurbsCurve nurbsCurve = c.ToNurbsCurve();

    double t = nurbsCurve.Knots[nurbsCurve.Order - 2];
    Print("t -->" + t.ToString());

    // delta_t = {knot[order-1] - t, knot[order] -  t, .. knot[2*order-3] - t}
    List<double> delta_t = new List<double>();
    int knotsStart = nurbsCurve.Degree;

    int k = nurbsCurve.Degree;
    int i = 0;
    while(k-- > 0)
    {
      delta_t.Add(knots[knotsStart + i] - t);
      i++;
    }

    // Points converted in a list of doubles as of their cv input.
    int cv_stride = (nurbsCurve.IsRational) ? nurbsCurve.Dimension + 1 : nurbsCurve.Dimension;
    List<double> cv = new List<double>();
    foreach (var pt in nurbsCurve.Points)
    {
      cv.Add(pt.X);
      cv.Add(pt.Y);
      cv.Add(pt.Z);
      if(nurbsCurve.IsRational)
      {
        cv.Add(pt.Weight);
      }
    }

    Print("PointSize -->" + nurbsCurve.Points.PointSize.ToString());
    Print("Delta -->" + delta_t.Count.ToString());

    int j = nurbsCurve.Order;
    int deltaInt = nurbsCurve.Degree;
    while(--j > 0) // while(--k)
    {
      // Data
      Print("Start the primary while");
      string cvString = "";
      for (int v = 0; v < cv.Count; v++)
      {
        cvString += cv[v].ToString() + "-";
      }
      Print("Cv -->" + cvString);

      int m = j;
      int counter = 0;
      int ptsCounter = 0;
      //Print("deltaStart -->" + (delta_t.Count - deltaInt).ToString());

      while(m-- > 0) // while(i--)
      {
        double k0 = knots[knotsStart - j + counter];
        double k1 = knots[knotsStart + counter];
        Print("k0 -->" + k0.ToString());
        Print("k1 -->" + k1.ToString());

        double alpha0 = delta_t[counter] / (k1 - k0);
        double alpha1 = 1.0 - alpha0;

        Print("alpha0 -->" + alpha0.ToString());
        Print("alpha1 -->" + alpha1.ToString());

        int n = nurbsCurve.Dimension;
        int ptCounter = 0;
        while(n-- > 0) // while(j--)
        {
          var cv1 = cv[cv_stride + ptCounter + ptsCounter];
          Print("Cv1 -->" + cv1.ToString());
          var cv0 = cv[ptCounter + ptsCounter];
          Print("Cv0 -->" + cv0.ToString());

          cv[ptCounter + ptsCounter] = (cv0 * alpha0) + (cv1 * alpha1);
          Print("cv[]" + (ptCounter + ptsCounter).ToString() + "-->" + cv[ptCounter + ptsCounter].ToString());
          ptCounter++;
        }

        counter++;
        deltaInt = j;
        ptsCounter += cv_stride; // this is equivalent to cv_inc = cv_stride - cv_dim
      }
    }

    List<Point3d> pts = new List<Point3d>();
    for (int h = 0; h < cv.Count; h += cv_stride)
    {
      pts.Add(new Point3d(cv[h], cv[h + 1], cv[h + 2]));
    }

    A = pts;
    B = delta_t;
# ---------- end c_script_16 ----------
panel_110 = Panel(c_script_13.A)
panel_111 = Panel(c_script_14.A)

# ----
xprod_3 = CrossProduct(VectorA=vec_4, VectorB=xprod_2.Vector, Unitize=False)  # -> Vector, Length
vdis_4 = VectorDisplay(Anchor=pt_33, Vector=xprod_3.Vector)
crv = Curve(<curve referenced from the Rhino model>)
unit_2 = UnitVector(Vector=vec_4)
unit_3 = UnitVector(Vector=xprod_3.Vector)
eval_11 = EvaluateLength(Curve=crv, Length="10", Normalized=False)  # -> Point, Tangent, Parameter
len_4 = Length(Curve=crv)
panel_112 = Panel(eval_11.Point)

# ---- group: CONVEX HULL 3D / GENERATE RANDOM PTS ON SPHERE
sph = Sphere(Base=PlaneXY(0, 0, 0), Radius=10)
popgeo = PopulateGeometry(Geometry=sph, Count=20, Seed=1)

# ---- group: CONVEX HULL 3D / RESULT FROM VS UNIT CONVEX HULL TEST
c_script_17 = CSharpScript()  # -> out, A
# ---------- c_script_17: C# ----------
    var pts = new List<Point3d>()
      {
        new Point3d(4.856799, -8.735927, 0.308344),
        new Point3d(9.232401, -3.590601, -1.367609),
        new Point3d(7.202291, -2.427026, 6.498965),
        new Point3d(1.881371, 2.128979, -9.587903),
        new Point3d(7.634068, 6.375793, -1.034536),
        new Point3d(5.167184, -3.885535, -7.629078),
        new Point3d(-6.435259, -3.556436, 6.777847),
        new Point3d(-2.650043, 2.574374, 9.292463),
        new Point3d(-9.473178, 2.291361, 2.237982),
        new Point3d(2.353462, 2.067135, 9.496745),
        new Point3d(4.526953, 6.246705, 6.362812),
        new Point3d(-2.650043, 2.574374, 9.292463),
        new Point3d(1.881371, 2.128979, -9.587903),
        new Point3d(-5.287558, 4.189759, -7.381575),
        new Point3d(-1.618406, 9.624193, -2.18075),
        new Point3d(-6.235135, 7.505124, 2.190026),
        new Point3d(4.526953, 6.246705, 6.362812),
        new Point3d(-1.618406, 9.624193, -2.18075),
        new Point3d(0.945476, -9.046681, -4.154954),
        new Point3d(5.167184, -3.885535, -7.629078),
        new Point3d(4.856799, -8.735927, 0.308344),
        new Point3d(-8.716214, -2.91291, -3.942407),
        new Point3d(-5.3673, -8.173048, -2.096037),
        new Point3d(-6.435259, -3.556436, 6.777847),
        new Point3d(4.526953, 6.246705, 6.362812),
        new Point3d(7.634068, 6.375793, -1.034536),
        new Point3d(-1.618406, 9.624193, -2.18075),
        new Point3d(1.881371, 2.128979, -9.587903),
        new Point3d(-1.618406, 9.624193, -2.18075),
        new Point3d(7.634068, 6.375793, -1.034536),
        new Point3d(9.232401, -3.590601, -1.367609),
        new Point3d(7.634068, 6.375793, -1.034536),
        new Point3d(7.202291, -2.427026, 6.498965),
        new Point3d(0.836308, -3.646638, 9.27376),
        new Point3d(-2.650043, 2.574374, 9.292463),
        new Point3d(-6.435259, -3.556436, 6.777847),
        new Point3d(-6.235135, 7.505124, 2.190026),
        new Point3d(-1.618406, 9.624193, -2.18075),
        new Point3d(-5.287558, 4.189759, -7.381575),
        new Point3d(-6.235135, 7.505124, 2.190026),
        new Point3d(-2.650043, 2.574374, 9.292463),
        new Point3d(4.526953, 6.246705, 6.362812),
        new Point3d(2.353462, 2.067135, 9.496745),
        new Point3d(7.202291, -2.427026, 6.498965),
        new Point3d(4.526953, 6.246705, 6.362812),
        new Point3d(4.526953, 6.246705, 6.362812),
        new Point3d(7.202291, -2.427026, 6.498965),
        new Point3d(7.634068, 6.375793, -1.034536),
        new Point3d(-8.716214, -2.91291, -3.942407),
        new Point3d(-2.027307, -2.06058, -9.573089),
        new Point3d(-5.3673, -8.173048, -2.096037),
        new Point3d(0.945476, -9.046681, -4.154954),
        new Point3d(-2.027307, -2.06058, -9.573089),
        new Point3d(5.167184, -3.885535, -7.629078),
        new Point3d(4.856799, -8.735927, 0.308344),
        new Point3d(5.167184, -3.885535, -7.629078),
        new Point3d(9.232401, -3.590601, -1.367609),
        new Point3d(9.232401, -3.590601, -1.367609),
        new Point3d(5.167184, -3.885535, -7.629078),
        new Point3d(7.634068, 6.375793, -1.034536),
        new Point3d(4.856799, -8.735927, 0.308344),
        new Point3d(7.202291, -2.427026, 6.498965),
        new Point3d(-0.285312, -8.002962, 5.989256),
        new Point3d(0.945476, -9.046681, -4.154954),
        new Point3d(-5.3673, -8.173048, -2.096037),
        new Point3d(-2.027307, -2.06058, -9.573089),
        new Point3d(-8.716214, -2.91291, -3.942407),
        new Point3d(-5.287558, 4.189759, -7.381575),
        new Point3d(-2.027307, -2.06058, -9.573089),
        new Point3d(-6.435259, -3.556436, 6.777847),
        new Point3d(-5.3673, -8.173048, -2.096037),
        new Point3d(-0.285312, -8.002962, 5.989256),
        new Point3d(-2.027307, -2.06058, -9.573089),
        new Point3d(-5.287558, 4.189759, -7.381575),
        new Point3d(1.881371, 2.128979, -9.587903),
        new Point3d(-2.027307, -2.06058, -9.573089),
        new Point3d(1.881371, 2.128979, -9.587903),
        new Point3d(5.167184, -3.885535, -7.629078),
        new Point3d(-8.716214, -2.91291, -3.942407),
        new Point3d(-6.435259, -3.556436, 6.777847),
        new Point3d(-9.473178, 2.291361, 2.237982),
        new Point3d(-8.716214, -2.91291, -3.942407),
        new Point3d(-9.473178, 2.291361, 2.237982),
        new Point3d(-5.287558, 4.189759, -7.381575),
        new Point3d(-6.235135, 7.505124, 2.190026),
        new Point3d(-5.287558, 4.189759, -7.381575),
        new Point3d(-9.473178, 2.291361, 2.237982),
        new Point3d(-6.235135, 7.505124, 2.190026),
        new Point3d(-9.473178, 2.291361, 2.237982),
        new Point3d(-2.650043, 2.574374, 9.292463),
        new Point3d(0.945476, -9.046681, -4.154954),
        new Point3d(4.856799, -8.735927, 0.308344),
        new Point3d(-0.285312, -8.002962, 5.989256),
        new Point3d(0.945476, -9.046681, -4.154954),
        new Point3d(-0.285312, -8.002962, 5.989256),
        new Point3d(-5.3673, -8.173048, -2.096037),
        new Point3d(0.836308, -3.646638, 9.27376),
        new Point3d(-6.435259, -3.556436, 6.777847),
        new Point3d(-0.285312, -8.002962, 5.989256),
        new Point3d(0.836308, -3.646638, 9.27376),
        new Point3d(-0.285312, -8.002962, 5.989256),
        new Point3d(7.202291, -2.427026, 6.498965),
        new Point3d(2.353462, 2.067135, 9.496745),
        new Point3d(-2.650043, 2.574374, 9.292463),
        new Point3d(0.836308, -3.646638, 9.27376),
        new Point3d(2.353462, 2.067135, 9.496745),
        new Point3d(0.836308, -3.646638, 9.27376),
        new Point3d(7.202291, -2.427026, 6.498965)
        };




    A = pts;
# ---------- end c_script_17 ----------

# ---- group: CONVEX HULL 3D / CENTROID
pt_34 = ConstructPoint(XCoordinate=0, YCoordinate=0, ZCoordinate=0)

# ----
number_slider = Slider(0.884, range=0..10)
number_slider_2 = Slider(1, range=0..1)

# ---- group: TestOnCurve
panel_113 = Panel("""{5,5,0}
{10,10,0}
{20,15,0}
{35,15,0}
{45,10,0}
{50,5,0}""")
panel_114 = Panel("""{5,5,0}
{20,15,0}
{35,15,0}
{50,5,0}""")
panel_115 = Panel("""{0,0,0}
{20,0,0}
{20,20,0}
{40,20,0}""")
panel_116 = Panel("3")
pt_35 = Point(panel_114)
pt_36 = Point(panel_115)
pt_37 = Point(panel_113)
number_slider_3 = Slider(0.36, range=0..1)
nurbs_5 = NurbsCurve(Vertices=pt_37, Degree=panel_116, Periodic=False)  # -> reparameterize(Curve), Length, Domain
fit = FitCurve(Curve=nurbs_5.Curve, Degree=2, Tolerance="0.001")
cp_8 = ControlPoints(Curve=fit)  # -> Points, Weights, Knots
len_5 = Length(Curve=nurbs_5.Curve)
# All these definitions were used to convalidate and developed the GeometrySharp tests.
panel_117 = Panel("7")
cp_9 = ControlPoints(Curve=nurbs_5.Curve)  # -> Points, Weights, Knots
crv_cp_4 = CurveClosestPoint(Point=cp_8.Points, Curve=nurbs_5.Curve)  # -> Point, Parameter, Distance
lng_2 = ListLength(List=cp_8.Points)
division_3 = Division(A=nurbs_5.Length, B=panel_117)
crv_cp_5 = CurveClosestPoint(Point=crv_cp_4.Point, Curve=fit)  # -> Point, Parameter, Distance
c_script_18 = CSharpScript(V=pt_37, t=number_slider_3, d=panel_116, Reference="D:\MyFolder\VerbNurbs\verb\build\cs\bin\Verb.dll")  # -> out, PT, VE, o; inputs V: list of Vector3d, t: Double, d: Int32
# ---------- c_script_18: C# usings ----------
using verb.core;
using System.Linq;
# ---------- c_script_18: C# ----------
    var pts = new Array<object>();
    for (int i = 0; i < V.Count; i++)
      pts.push(new Array<double>(new double[] { V[i].X, V[i].Y, V[i].Z }));

    var curve = verb.geom.NurbsCurve.byPoints(pts, d);

    var ptAt = curve.point(t);
    var vec = verb.core.Vec.normalized(curve.tangent(t));

    PT = ToPoint(ptAt);
    VE = ToPoint(vec);
    o = curve.knots();
# ---------- c_script_18: C# additional code ----------
  public Point3d ToPoint(Array<double> pt)
  {
    var X = System.Math.Round(double.IsNaN(pt[0]) ? 0 : pt[0], 6);
    var Y = System.Math.Round(double.IsNaN(pt[1]) ? 0 : pt[1], 6);
    var Z = System.Math.Round(double.IsNaN(pt[2]) ? 0 : pt[2], 6);
    return new Point3d(X, Y, Z);
  }
# ---------- end c_script_18 ----------
eval_12 = EvaluateCurve(Curve=nurbs_5.Curve, Parameter=number_slider_3)  # -> Point, Tangent, Angle
divide = DivideCurve(Curve=nurbs_5.Curve, Count=panel_117, Kinks=False)  # -> Points, Tangents, Parameters
divlength = DivideLength(Curve=nurbs_5.Curve, Length=division_3)  # -> Points, Tangents, Parameters
shift = ShiftList(List=crv_cp_5.Parameter, Shift=1, Wrap=True)
panel_118 = Panel(divide.Parameters)
subtraction_3 = Subtraction(A=shift, B=crv_cp_5.Parameter)
panel_119 = Panel(subtraction_3)

# ---- group: TestOnCurve / VerbTest
c_script_19 = CSharpScript(
    V=cp_9.Points,
    W=cp_9.Weights,
    K=cp_9.Knots,
    t=number_slider_3,
    d=panel_116,
    Reference="D:\MyFolder\VerbNurbs\verb\build\cs\bin\Verb.dll")  # -> out, PT, VE, o; inputs V: list of Vector3d, W: list of Double, K: list of Double, t: Double, d: Int32
# ---------- c_script_19: C# ----------
    var pts = new Array<object>();
    var newKnots = new List<double>();
    newKnots.Add(K[0]);
    newKnots.AddRange(K);
    newKnots.Add(K[K.Count - 1]);
    o = newKnots;

    for (int i = 0; i < V.Count; i++)
      pts.push(new Array<double>(new double[] { V[i].X, V[i].Y, V[i].Z }));

    var knots = new Array<double>(newKnots.ToArray());
    var weights = new Array<double>(W.ToArray());

    var curve = verb.geom.NurbsCurve.byKnotsControlPointsWeights(d, knots, pts, weights);

    var ptAt = curve.point(t);
    var vec = verb.core.Vec.normalized(curve.tangent(t));

    PT = ToPoint(ptAt);
    VE = ToPoint(vec);
# ---------- c_script_19: C# additional code ----------
  public Point3d ToPoint(Array<double> pt)
  {
    var X = System.Math.Round(double.IsNaN(pt[0]) ? 0 : pt[0], 6);
    var Y = System.Math.Round(double.IsNaN(pt[1]) ? 0 : pt[1], 6);
    var Z = System.Math.Round(double.IsNaN(pt[2]) ? 0 : pt[2], 6);
    return new Point3d(X, Y, Z);
  }
# ---------- end c_script_19 ----------

# ---- group: TestOnCurve (continued)
panel_120 = Panel([eval_12.Point, c_script_19.PT, c_script_18.PT])
vdis_5 = VectorDisplay(Anchor=c_script_19.PT, Vector=c_script_19.VE)
panel_121 = Panel([eval_12.Tangent, c_script_19.VE])

# ---- group: Polyline
panel_122 = Panel("""{5, 7.5, 0}
{15, -3, 5}
{22.5, 12, -3}""")
panel_123 = Panel("""{5,5,0}
{5,10,0}
{5,15,0}
{15,12,0}
{20,-25,0}
{20,-20,0}""")
panel_124 = Panel("""{5, 0, 0}
{15, 15, 0}
{20, 5, 0}
{30, 10, 0} 
{45, 12.5, 0}""")
panel_125 = Panel("""0.0
0.25
2.5
4.0""")
pt_38 = Point(panel_124)
pt_39 = Point("{17, 8, 0}")
pline_4 = PolyLine(Vertices=pt_38, Closed=False)
explode = Explode(Curve=pline_4, Recursive=True)  # -> Segments, Vertices
len_6 = Length(Curve=pline_4)
transform_4 = Transform(Geometry=pline_4, Transform=comp)
explode_2 = Explode(Curve=transform_4, Recursive=True)  # -> Segments, Vertices
panel_126 = Panel(len_6)
dist_2 = Distance(PointA=explode.Vertices, PointB=explode_2.Vertices)
bbox_6 = BoundingBox(Content=pline_4, Plane=PlaneXY(0, 0, 0))  # -> Box, Box_2
c_script_20 = CSharpScript(p=pline_4, t=panel_125)  # -> out, pt, tg, sg; inputs p: Polyline, t: Double
# ---------- c_script_20: C# ----------
    pt = p.PointAt(t);
    tg = p.TangentAt(t);
    sg = p.SegmentAt((int)t);
# ---------- end c_script_20 ----------
crv_cp_6 = CurveClosestPoint(Point=pt_39, Curve=pline_4)  # -> Point, Parameter, Distance
panel_127 = Panel(dist_2)
box_corners_6 = BoxCorners(Box=bbox_6.Box)  # -> CornerA, CornerB, CornerC, CornerD, CornerE, CornerF, CornerG, CornerH
panel_128 = Panel(crv_cp_6.Point)
panel_129 = Panel(c_script_20.sg)
panel_130 = Panel(c_script_20.tg)
panel_131 = Panel(c_script_20.pt)
panel_132 = Panel([box_corners_6.CornerA, box_corners_6.CornerC])

# ----
pt_40 = Point(panel_122)

# ---- group: Polyline (continued)
c_script_21 = CSharpScript(p=pline_4, pt=pt_40)  # -> out, t; inputs p: Polyline, pt: Point3d
# ---------- c_script_21: C# ----------
    t = p.ClosestParameter(pt);
# ---------- end c_script_21 ----------
panel_133 = Panel(c_script_21.t)

# ---- group: Binomial
number_slider_4 = Slider(6, range=0..10)
number_slider_5 = Slider(2, range=0..10)
c_script_22 = CSharpScript(Kval=number_slider_4, Ival=number_slider_5)  # -> out, A; inputs Kval: Int32, Ival: Int32
# ---------- c_script_22: C# ----------
    double t = Binomial.Get(Kval, Ival);
    A = t;
# ---------- c_script_22: C# additional code ----------
  public class Binomial
  {
    private static Dictionary<int, Tuple<int, double>> _storage = new Dictionary<int, Tuple<int, double>>();

    public static double Get(int n, int k)
    {
      if (k == 0.0) return 1.0;
      if (n == 0 || k > n) return 0.0;
      if (k > n - k) k = n - k;

      if (_storage.ContainsKey(n) && _storage[n].Item1 == k)
        return _storage[n].Item2;

      var r = 1.0;
      var n0 = n;

      for (int d = 1; d < k + 1; d++)
      {
        if (_storage.ContainsKey(n0) && _storage[n0].Item1 == d)
        {
          n--;
          r = _storage[n0].Item2;
          continue;
        }

        r *= n--;
        r /= d;

        if(!_storage.ContainsKey(n0))
        {
          Tuple<int, double> temp = new Tuple<int, double>(d, r);
          _storage.Remove(n0);
          _storage.Add(n0, temp);
        }
      }

      return r;
    }
  }
# ---------- end c_script_22 ----------
python_4 = GhPythonScript(Kval=number_slider_4, Ival=number_slider_5)  # -> out, a; inputs Kval: Int32, Ival: Int32
# ---------- python_4: Python ----------
__author__ = "m.bianchini"
__version__ = "2021.01.18"

import rhinoscriptsyntax as rs
import math

def binomial_coefficient(k, i):
    """ Computes the binomial coefficient (denoted by *k choose i*).
    Please see the following website for details: http://mathworld.wolfram.com/BinomialCoefficient.html
    :param k: size of the set of distinct elements
    :type k: int
    :param i: size of the subsets
    :type i: int
    :return: combination of *k* and *i*
    :rtype: float
    """
    # Special case
    if i > k:
        return float(0)
    # Compute binomial coefficient
    k_fact = math.factorial(k)
    i_fact = math.factorial(i)
    k_i_fact = math.factorial(k - i)
    return float(k_fact / (k_i_fact * i_fact))

a = binomial_coefficient(Kval, Ival)
# ---------- end python_4 ----------
panel_134 = Panel(python_4.a)

# ----
c_script_23 = CSharpScript(K=number_slider_5, I=number_slider_4)  # -> out, A; inputs K: Int32, I: Int32
# ---------- c_script_23: C# ----------
    A = BinomialCoefficient(I, K);
# ---------- c_script_23: C# additional code ----------
  public double BinomialCoefficient(int n, int i)
  {
    return Factorial(n) / (Factorial(i) * Factorial(n - i));
  }

  private int Factorial(int n)
  {
    if (n == 0)
    {
      return 1;
    }

    var fact = n;
    for (var i = n - 1; i >= 1; i--)
    {
      fact *= i;
    }
    return fact;
  }
# ---------- end c_script_23 ----------

# ---- group: Binomial (continued)
panel_135 = Panel([c_script_22.A, c_script_23.A])

# ----
panel_136 = Panel("{0,10,0}")
panel_137 = Panel("{10,0,0}")
ln_8 = Line(StartPoint="{0,0,0}", EndPoint="{5,5,10}")
xy_3 = XYPlane(Origin=Point(0, 0, 0))
yz_4 = YZPlane(Origin="{10,20,5}")
xz = XZPlane(Origin="{10,-10,-5}")
ppx = PlanePlane(PlaneA=yz_4, PlaneB=xz)
ppx_2 = PlanePlane(PlaneA=xy_3, PlaneB=yz_4)
plx = LinePlane(Line=ln_8, Plane=yz_4)  # -> Point, ParamL, ParamP
curvepoint = PointOnCurve(ppx_2, parameter=0)
vec_5 = Vector(ppx_2)
curvepoint_2 = PointOnCurve(ppx, parameter=0)
vec_6 = Vector(ppx)
panel_138 = Panel([curvepoint, vec_5])
panel_139 = Panel([curvepoint_2, vec_6])

# ---- group: Plane_Equation_ValueAt
c_script_24 = CSharpScript(pl=yz_4, pt="{20,20,10}")  # -> out, A; inputs pl: Plane, pt: Point3d
# ---------- c_script_24: C# ----------
    double[] d = pl.GetPlaneEquation();
    A = d;
# ---------- end c_script_24 ----------
item_3 = ListItem(List=c_script_24.A, Index=0, Wrap=True)  # -> Item, Item1, Item2, Item3
pdecon = Deconstruct(Point="{0,0,0}")  # -> XComponent, YComponent, ZComponent
multiplication_7 = Multiplication(A=pdecon.YComponent, B=item_3.Item1)
multiplication_8 = Multiplication(A=pdecon.ZComponent, B=item_3.Item2)
multiplication_9 = Multiplication(A=pdecon.XComponent, B=item_3.Item)
addition_4 = Addition(A=multiplication_9, B=multiplication_7, C=multiplication_8, D=item_3.Item3)

# ---- group: LineCircle
ln_9 = Line(StartPoint="{10,29.769674,17.028815}", EndPoint="{10,37.594559,24.680781}")
ln_10 = Line(StartPoint="{-15,45,17}", EndPoint="{15,45,25}")
ln_11 = Line(StartPoint="{10,40,25}", EndPoint="{10,40,15}")
c_script_25 = CSharpScript(pl=yz_4, ln=ln_11)  # -> out, A; inputs pl: Plane, ln: Line
# ---------- c_script_25: C# ----------
    Circle c = new Circle(pl, 20);
    double t1, t2;
    Point3d point1, point2;
    var i = Rhino.Geometry.Intersect.Intersection.LineCircle(ln, c, out t1, out point1, out t2, out point2);
    A = new Point3d[]{point1, point2};
# ---------- end c_script_25 ----------

# ---- group: PolylinePlane
crv_2 = Curve(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)
pcx_3 = CurvePlane(Curve=crv_2, Plane=yz_4)  # -> Points, ParamsC, ParamsP

# ---- group: PlaneCircle
pt_41 = Point(Point(10, 10, 10))
pt_42 = Point(Point(10, 20, 25))
pl_3 = PlaneNormal(Origin=pt_41, ZAxis=pt_42)
c_script_26 = CSharpScript(pl=yz_4, plS=pl_3)  # -> out, A, B; inputs pl: Plane, plS: Plane
# ---------- c_script_26: C# ----------
    Circle c = new Circle(pl, 20);
    double t1, t2;
    Point3d point1, point2;
    var i = Rhino.Geometry.Intersect.Intersection.PlaneCircle(plS, c, out t1, out t2);
    point1 = c.PointAt(t1);
    point2 = c.PointAt(t2);
    A = new Point3d[]{point1, point2};
    B = c;
# ---------- end c_script_26 ----------

# ----
panel_140 = Panel(c_script_25.A)

# ---- group: VectorRotation / RodrigoFormula
panel_141 = Panel("""-0.00000125
0.0
12.5
450""")
rad_4 = Radians(Degrees=panel_141)
cos_2 = Cosine(Value=rad_4)
sin_2 = Sine(Value=rad_4)
subtraction_4 = Subtraction(A=1, B=cos_2)

# ---- group: VectorRotation
pt_43 = ConstructPoint(XCoordinate="-7", YCoordinate="10", ZCoordinate="-5")
pt_44 = ConstructPoint(XCoordinate=0, YCoordinate=0, ZCoordinate=0)
c_script_27 = CSharpScript(pt=pt_44, Dir=pt_43)  # -> out, A; inputs pt: Point3d, Dir: Vector3d
# ---------- c_script_27: C# ----------
    Ray3d r = new Ray3d(pt, Dir);

    var yAxis = Vector3d.YAxis;
    yAxis.PerpendicularTo(r.Direction);
    A = yAxis;
# ---------- end c_script_27 ----------
unit_4 = UnitVector(Vector=c_script_27.A)
vdis_6 = VectorDisplay(Anchor=pt_44, Vector=c_script_27.A)
vdis_7 = VectorDisplay(Anchor=pt_44, Vector=pt_43)
vrot = Rotate(Vector=pt_43, Axis=unit_4, Angle=rad_4)
panel_142 = Panel(vrot)

# ---- group: VectorRotation / RodrigoFormula (continued)
xprod_4 = CrossProduct(VectorA=unit_4, VectorB=pt_43, Unitize=False)  # -> Vector, Length
dprod_2 = DotProduct(VectorA=unit_4, VectorB=pt_43, Unitize=False)
multiplication_10 = Multiplication(A=unit_4, B=dprod_2)
multiplication_11 = Multiplication(A=sin_2, B=xprod_4.Vector)
multiplication_12 = Multiplication(A=pt_43, B=cos_2)
multiplication_13 = Multiplication(A=subtraction_4, B=multiplication_10)
addition_5 = Addition(A=multiplication_12, B=multiplication_11, C=multiplication_13)

# ---- group: VectorRotation (continued)
panel_143 = Panel(addition_5)
vdis_8 = VectorDisplay(Anchor=pt_44, Vector=[vrot, addition_5])

# ---- group: Decomposing in Bezier and Bounding Box
panel_144 = Panel("""{4.5, 2.5, 2.5}
{5, 5, 5}
{0, 5, 0}""")
panel_145 = Panel("""{100,25,0}
{10,90,0}
{110,100,0}
{150,195,0}""")
panel_146 = Panel("""{-10,15,5}
{10,5,5}
{20,0,0}""")
panel_147 = Panel("""{0, 5, 5}
{0, 0, 0}
{4, 0, 0}
{5, 5, 5}
{0, 5, 0}""")
panel_148 = Panel("""{0,0,0}
{1,0,0}
{0.5,1,0}
{2,0,0}""")
nurbs_6 = NurbsCurve(Vertices=panel_147, Degree=2, Periodic=False)  # -> Curve, Length, Domain
panel_149 = Panel("""1
1
1""")
panel_150 = Panel("""0.0
0.0
1.0
1.0""")
nurbcrv_9 = NurbsCurvePWK(Points=panel_144, Weights=panel_149, Knots=panel_150)  # -> Curve, Length, Domain
bbox_7 = BoundingBox(Content=nurbs_6.Curve, Plane=PlaneXY(0, 0, 0))  # -> Box, Box_2
box_corners_7 = BoxCorners(Box=bbox_7.Box)  # -> CornerA, CornerB, CornerC, CornerD, CornerE, CornerF, CornerG, CornerH
pt_45 = Point(box_corners_7.CornerA)
pt_46 = Point(box_corners_7.CornerG)
pt_47 = Point(box_corners_7.CornerC)
panel_151 = Panel([pt_45, pt_46])

# ---- group: Decomposing in Bezier and Bounding Box / Decompose into Bezier
c_script_28 = CSharpScript(x=nurbs_6.Curve)  # -> out, A; inputs x: Curve
# ---------- c_script_28: C# usings ----------
using System.Linq;
# ---------- c_script_28: C# ----------
    NurbsCurve crv = x.ToNurbsCurve();
    List<BezierCurve> result = new List<BezierCurve>();
    crv.MakePiecewiseBezier(true);

    Point4d[] cp = new Point4d[crv.Order];
    int nTotal = 1;
    while (nTotal < crv.Points.Count)
    {
      --nTotal;
      for (int i = 0; i < crv.Order; ++i)
      {
        ControlPoint aControlPoint = crv.Points[nTotal++];
        double w = aControlPoint.Weight;
        cp[i] = new Point4d(w * aControlPoint.Location.X, w * aControlPoint.Location.Y,
          w * aControlPoint.Location.Z, w);
      }

      result.Add(new BezierCurve(cp));
    }
    A = result.Select(c => c.ToNurbsCurve()).ToList();
# ---------- end c_script_28 ----------

# ---- group: Decomposing in Bezier and Bounding Box (continued)
item_4 = ListItem(List=c_script_28.A, Index=0, Wrap=True)  # -> Item, Item1
cp_10 = ControlPoints(Curve=c_script_28.A)  # -> Points, Weights, Knots
panel_152 = Panel(cp_10.Points)

# ---- group: Join
panel_153 = Panel("""{0, 5, 5}
{0, 0, 0}
{5, 0, 0}
{5, 0, 5}
{5, 5, 5}
{5, 5, 0}""")
panel_154 = Panel("""{5, 5, 0}
{5, 5, -2.5}""")
panel_155 = Panel("""{5, 5, -2.5}
{5, 5, -7.5}
{10, 5, -7.5}""")
item_5 = ListItem(List=panel_155, Index=0, Wrap=True)  # -> Item, Item1, Item2
item_6 = ListItem(List=panel_154, Index=0, Wrap=True)  # -> Item, Item1
Z = UnitZ(Factor=expr("-x", 1))
nurbs_7 = NurbsCurve(Vertices=panel_153, Degree=3, Periodic=False)  # -> Curve, Length, Domain
arc_6 = ArcSED(Start=item_5.Item, End=item_5.Item2, Direction=Z)  # -> Arc, Plane, Radius
ln_12 = Line(StartPoint=item_6.Item, EndPoint=item_6.Item1)
pline_5 = PolyLine(Vertices=panel_153, Closed=False)
panel_156 = Panel("""0.1
0.25
0.75""")
merge_2 = Merge(Data1=nurbs_7.Curve, Data2=ln_12, Data3=arc_6.Arc)
merge_3 = Merge(Data1=pline_5, Data2=ln_12)
join = JoinCurves(Curves=reparameterize(merge_2), Preserve=False)  # -> reparameterize(Curves)
join_2 = JoinCurves(Curves=merge_3, Preserve=False)
c_script_29 = CSharpScript(c=join_2)  # -> out, A; inputs c: Polyline
# ---------- c_script_29: C# ----------
    NurbsCurve crv = c.ToNurbsCurve();
    A = crv;
# ---------- end c_script_29 ----------
eval_13 = EvaluateCurve(Curve=reparameterize(c_script_29.A), Parameter=panel_156)  # -> Point, Tangent, Angle
panel_157 = Panel(eval_13.Point)

# ----
c_script_30 = CSharpScript(c=join)  # -> out, A; inputs c: Curve; same code as c_script_29

# ---- group: Join (continued)
eval_14 = EvaluateCurve(Curve=c_script_30.A, Parameter=panel_156)  # -> Point, Tangent, Angle
cp_11 = ControlPoints(Curve=c_script_30.A)  # -> Points, Weights, Knots
panel_158 = Panel(cp_11.Points)
panel_159 = Panel(cp_11.Knots)
panel_160 = Panel(eval_14.Point)

# ----
tonurb = CSharpScript(C=arc_6.Arc)  # -> out, N; inputs C: Curve
# ---------- tonurb: C# ----------
    if (null != C && C.IsValid)
      N = C.ToNurbsCurve();
# ---------- end tonurb ----------
cdiv_2 = Derivatives(Curve=reparameterize(tonurb.N), Parameter="0.8")  # -> Point, FirstDerivative, SecondDerivative
unit_5 = UnitVector(Vector=cdiv_2.FirstDerivative)
unit_6 = UnitVector(Vector=cdiv_2.SecondDerivative)
panel_161 = Panel([cdiv_2.Point, cdiv_2.FirstDerivative, cdiv_2.SecondDerivative])
dprod_3 = DotProduct(VectorA=unit_6, VectorB=unit_3, Unitize=False)
dprod_4 = DotProduct(VectorA=unit_2, VectorB=unit_5, Unitize=False)
cp_12 = ControlPoints(Curve=nurbs_7.Curve)  # -> Points, Weights, Knots
panel_162 = Panel(dprod_3)
panel_163 = Panel(dprod_4)

# ---- group: ROTATION MINIMIZING CURVE FRAMES
crv_3 = Curve(reparameterize(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))
cp_13 = ControlPoints(Curve=crv_3)  # -> Points, Weights, Knots
panel_164 = Panel(cp_13.Knots)
pframe = PerpFrame(Curve=reparameterize(crv_3), Parameter=Slider(1, range=0..1))
format = Format(Format="{0}", Culture=127, Data0=cp_13.Points)
divide_2 = DivideCurve(Curve=simplify(crv_3), Count=Slider(55, range=0..100), Kinks=False)  # -> Points, Tangents, Parameters
frame = CurveFrame(Curve=crv_3, Parameter=Slider(0, range=0..100))
panel_165 = Panel(format)
format_2 = Format(Format=divide_2.Parameters, Culture=127, Data0=cp_13.Points)
number_slider_6 = Slider(1, range=0..10)
eval_15 = EvaluateCurve(Curve=crv_3, Parameter=divide_2.Parameters)  # -> Point, Tangent, Angle
gh_curve_divide_by_count_10 = Panel(format_2)
amp_2 = Amplitude(Vector=eval_15.Tangent, Amplitude=number_slider_6)
gshark_curve_divide_by_count_10 = Panel("""0
0.060488954186439514
0.18695741891860962
0.3504638969898224
0.4993707835674286
0.6497807204723358
0.7682546079158783
0.8546818941831589
0.9156603962182999
0.9621489569544792
0.9999999925494194""")
pt_48 = Point(eval_15.Point)
pframes = PerpFrames(Curve=crv_3, Count=10, Align=True)  # -> Frames, Parameters
rectangle = Rectangle(Plane=pframes.Frames, XSize=Domain(-0.1, 0.1), YSize=Domain(-0.1, 0.1), Radius=0)  # -> Rectangle, Length
loft = Loft(
    Curves=rectangle.Rectangle,
    Options={Adjust=False, Closed=False, LoftEnds=0, LoftSimp=0, LoftType=0, Rebuild=10, Refit=0.01})
panel_166 = Panel("new Plane(new Point3({0}), new Vector3({1}), new Vector3({2}))")
preview = CustomPreview(Geometry=loft, Material=ColourSwatch(SwatchColor=RGBA(181, 160, 101, 202)))

# ---- group: ROTATION MINIMIZING CURVE FRAMES / first reference frame
perpendicular_to = CSharpScript(V=eval_15.Tangent)  # -> out, A; inputs V: Vector3d
# ---------- perpendicular_to: C# ----------
    A = PerpendicularTo(V);
# ---------- perpendicular_to: C# additional code ----------
  public Vector3d PerpendicularTo(Vector3d vector)
  {
    double[] vectorComponents = {vector.X, vector.Y, vector.Z};
    double[] tempVector = new double[3];
    int i, j, k;
    double a, b;
    if (Math.Abs(vectorComponents[1]) > Math.Abs(vectorComponents[0]))
    {
      if (Math.Abs(vectorComponents[2]) > Math.Abs(vectorComponents[1]))
      {
        // |v.z| > |v.y| > |v.x|
        i = 2;
        j = 1;
        k = 0;
        a = vectorComponents[2];
        b = -vectorComponents[1];
      }
      else if (Math.Abs(vectorComponents[2]) > Math.Abs(vectorComponents[0]))
      {
        // |v.y| >= |v.z| >= |v.x|
        i = 1;
        j = 2;
        k = 0;
        a = vectorComponents[1];
        b = -vectorComponents[2];
      }
      else
      {
        // |v.y| > |v.x| > |v.z|
        i = 1;
        j = 0;
        k = 2;
        a = vectorComponents[1];
        b = -vectorComponents[0];
      }
    }
    else if (Math.Abs(vectorComponents[2]) > Math.Abs(vectorComponents[0]))
    {
      // |v.z| > |v.x| >= |v.y|
      i = 2;
      j = 0;
      k = 1;
      a = vectorComponents[2];
      b = -vectorComponents[0];
    }
    else if (Math.Abs(vectorComponents[2]) > Math.Abs(vectorComponents[1]))
    {
      // |v.x| >= |v.z| > |v.y|
      i = 0;
      j = 2;
      k = 1;
      a = vectorComponents[0];
      b = -vectorComponents[2];
    }
    else
    {
      // |v.x| >= |v.y| >= |v.z|
      i = 0;
      j = 1;
      k = 2;
      a = vectorComponents[0];
      b = -vectorComponents[1];
    }

    tempVector[i] = b;
    tempVector[j] = a;
    tempVector[k] = 0.0;

    return new Vector3d(tempVector[0], tempVector[1], tempVector[2]);
  }
# ---------- end perpendicular_to ----------
amp_3 = Amplitude(Vector=perpendicular_to.A, Amplitude=number_slider_6)
vdis_9 = VectorDisplay(Anchor=eval_15.Point, Vector=amp_3)

# ---- group: ROTATION MINIMIZING CURVE FRAMES / tangent
vdis_10 = VectorDisplay(Anchor=eval_15.Point, Vector=amp_2)
vec_7 = Vector(eval_15.Tangent)

# ---- group: ROTATION MINIMIZING CURVE FRAMES / perp to tangent
vec_8 = Vector(perpendicular_to.A)

# ---- group: CONVEX HULL 3D
sift = SiftPattern(List=c_script_17.A, SiftPattern=[0, 1, 2])  # -> Output0, Output1, Output2
clean = CleanTree(RemoveNulls=True, RemoveInvalid=True, RemoveEmpty=True, Tree=sift.Output0)
ins = InsertItems(List=popgeo, Item=pt_34, Indices=0, Wrap=True)
clean_2 = CleanTree(RemoveNulls=True, RemoveInvalid=True, RemoveEmpty=True, Tree=sift.Output1)
clean_3 = CleanTree(RemoveNulls=True, RemoveInvalid=True, RemoveEmpty=True, Tree=sift.Output2)
test_point_set_run_in_vs_unit_test = Panel(ins)
merge_4 = Merge(Data1=graft(clean), Data2=graft(clean_2), Data3=graft(clean_3))
panel_167 = Panel(merge_4)

# ---- group: CONVEX HULL 3D / MESH OUTPUT
conmesh = ConstructMesh(Vertices=merge_4, Faces={A=0, B=1, C=2, D=2})

# ---- group: CONVEX HULL 3D (continued)
medges = MeshEdges(Mesh=conmesh)  # -> NakedEdges, InteriorEdges, NonManifoldEdges

# ---- group: ROTATION MINIMIZING CURVE FRAMES (continued)
c_script_31 = CSharpScript(pointsOnCurve=pt_48, tangentVectorsAtPoints=vec_7, curve=crv_3)  # -> out, PerpFrames; inputs pointsOnCurve: list of Point3d, tangentVectorsAtPoints: list of Vector3d, curve: list of Curve
# ---------- c_script_31: C# ----------
    Plane[] output = new Plane[pointsOnCurve.Count];
    Curve crv = curve[0];
    double t = 0;
    crv.ClosestPoint(pointsOnCurve[0], out t);
    output[0] = CreateInitialFrame(crv, t);

    //Wang, W., J¨uttler, B., Zheng, D., and Liu, Y. 2008. "Computation of rotation minimizing frame."
    for(int i = 0; i < pointsOnCurve.Count - 1; i++)
    {
      Vector3d v1 = pointsOnCurve[i + 1] - pointsOnCurve[i];
      double c1 = v1 * v1;
      Vector3d rLi = output[i].XAxis - (2 / c1) * ( v1 * output[i].XAxis) * v1;
      Vector3d tLi = tangentVectorsAtPoints[i] - (2 / c1) * (v1 * tangentVectorsAtPoints[i]) * v1;
      Vector3d v2 = tangentVectorsAtPoints[i + 1] - tLi;
      double c2 = v2 * v2;
      Vector3d rINext = rLi - (2 / c2) * (v2 * rLi) * v2;
      var sINext = Vector3d.CrossProduct(tangentVectorsAtPoints[i + 1], rINext);
      var pln = new Plane();
      pln.Origin = pointsOnCurve[i + 1];
      pln.XAxis = rINext;
      pln.YAxis = sINext;
      pln.ZAxis = tangentVectorsAtPoints[i + 1];
      output[i + 1] = pln;
    }

    PerpFrames = output;
# ---------- c_script_31: C# additional code ----------
  public Plane CreateInitialFrame(Curve curve, double t)
  {
    var origin = curve.PointAt(t);
    var crvTan = curve.TangentAt(t);
    var crvNormal = PerpendicularTo(crvTan);
    var yAxis = Vector3d.CrossProduct(crvTan, crvNormal);
    var xAxis = Vector3d.CrossProduct(yAxis, crvTan);
    return new Plane(origin, xAxis, yAxis);
  }

  public Vector3d PerpendicularTo(Vector3d vector)
  {
    double[] vectorComponents = {vector.X, vector.Y, vector.Z};
    double[] tempVector = new double[3];
    int i, j, k;
    double a, b;
    if (Math.Abs(vectorComponents[1]) > Math.Abs(vectorComponents[0]))
    {
      if (Math.Abs(vectorComponents[2]) > Math.Abs(vectorComponents[1]))
      {
        // |v.z| > |v.y| > |v.x|
        i = 2;
        j = 1;
        k = 0;
        a = vectorComponents[2];
        b = -vectorComponents[1];
      }
      else if (Math.Abs(vectorComponents[2]) > Math.Abs(vectorComponents[0]))
      {
        // |v.y| >= |v.z| >= |v.x|
        i = 1;
        j = 2;
        k = 0;
        a = vectorComponents[1];
        b = -vectorComponents[2];
      }
      else
      {
        // |v.y| > |v.x| > |v.z|
        i = 1;
        j = 0;
        k = 2;
        a = vectorComponents[1];
        b = -vectorComponents[0];
      }
    }
    else if (Math.Abs(vectorComponents[2]) > Math.Abs(vectorComponents[0]))
    {
      // |v.z| > |v.x| >= |v.y|
      i = 2;
      j = 0;
      k = 1;
      a = vectorComponents[2];
      b = -vectorComponents[0];
    }
    else if (Math.Abs(vectorComponents[2]) > Math.Abs(vectorComponents[1]))
    {
      // |v.x| >= |v.z| > |v.y|
      i = 0;
      j = 2;
      k = 1;
      a = vectorComponents[0];
      b = -vectorComponents[2];
    }
    else
    {
      // |v.x| >= |v.y| >= |v.z|
      i = 0;
      j = 1;
      k = 2;
      a = vectorComponents[0];
      b = -vectorComponents[1];
    }

    tempVector[i] = b;
    tempVector[j] = a;
    tempVector[k] = 0.0;

    return new Vector3d(tempVector[0], tempVector[1], tempVector[2]);
  }
# ---------- end c_script_31 ----------
xprod_5 = CrossProduct(VectorA=vec_7, VectorB=vec_8, Unitize=False)  # -> Vector, Length
xprod_6 = CrossProduct(VectorA=xprod_5.Vector, VectorB=vec_7, Unitize=False)  # -> Vector, Length
pl_4 = ConstructPlane(Origin=eval_15.Point, XAxis=xprod_6.Vector, YAxis=xprod_5.Vector)
pln_3 = Plane(c_script_31.PerpFrames)
deplane_10 = DeconstructPlane(Plane=pln_3)  # -> Origin, XAxis, YAxis, ZAxis
amp_4 = Amplitude(Vector=deplane_10.XAxis, Amplitude=number_slider)
format_3 = Format(Format=panel_166, Culture=127, Data0=deplane_10.Origin, Data1=deplane_10.XAxis, Data2=deplane_10.YAxis)
output_for_unit_tests = Panel(format_3)

# ---- group: ROTATION MINIMIZING CURVE FRAMES / first ref frame
pl_5 = ConstructPlane(Origin=eval_15.Point, XAxis=vec_7, YAxis=xprod_5.Vector)

# ---- group: ROTATION MINIMIZING CURVE FRAMES (continued)
deplane_11 = DeconstructPlane(Plane=pl_5)  # -> Origin, XAxis, YAxis, ZAxis
pl_6 = ConstructPlane(Origin=deplane_11.Origin, XAxis=deplane_11.ZAxis, YAxis=deplane_11.YAxis)

# ----
amp_5 = Amplitude(Vector=deplane_10.YAxis, Amplitude=number_slider)
amp_6 = Amplitude(Vector=deplane_10.ZAxis, Amplitude=number_slider)
line = LineSDL(Start=deplane_10.Origin, Direction=amp_4, Length=amp_4)
line_2 = LineSDL(Start=deplane_10.Origin, Direction=amp_5, Length=amp_5)
line_3 = LineSDL(Start=deplane_10.Origin, Direction=amp_6, Length=amp_6)
preview_2 = CustomPreview(Geometry=line_2, Material=ColourSwatch(SwatchColor=RGB(76, 177, 186)))
preview_3 = CustomPreview(Geometry=line_3, Material=ColourSwatch(SwatchColor=RGB(255, 0, 0)))
preview_4 = CustomPreview(Geometry=line, Material=ColourSwatch(SwatchColor=RGB(204, 146, 45)))
